# Grasshopper definition 001-EQlib-Tensegrity-Tower.gh (Grasshopper 1.0.7)
# plug-ins: EQlib

level_height = Slider(5, range=0..10)
radius = Slider(3, range=0..10)
# Press "F5" to restart the simulation.
edges = Slider(5, range=0..10)
levels = Slider(5, range=0..10)
series = Series(Start=0, Step=1, Count=edges)
division = Division(A=6.283185307, B=edges)
multiplication = Multiplication(A=series, B=division)
pt = PointPolar(BasePlane=PlaneXY(0, 0, 0), XYAngle=multiplication, ZAngle=0, Offset=radius)
Z = UnitZ(Factor=level_height)
pt_2 = Point(pt)
move = Move(Geometry=pt_2, Motion=Z)  # -> Geometry, Transform
shift = ShiftList(List=move.Geometry, Shift=1, Wrap=True)
series_2 = Series(Start=0, Step=level_height, Count=levels)
weave = Weave(Pattern=[0, 1], Stream0=pt_2, Stream1=shift, NullGaps=False)
pline = PolyLine(Vertices=pt_2, Closed=True)
pline_2 = PolyLine(Vertices=move.Geometry, Closed=True)
Z_2 = UnitZ(Factor=series_2)
pline_3 = PolyLine(Vertices=weave, Closed=True)
move_2 = Move(Geometry=pline_3, Motion=Z_2)  # -> Geometry, Transform
move_3 = Move(Geometry=graft(pline_2), Motion=Z_2)  # -> Geometry, Transform
explode = Explode(Curve=move_2.Geometry, Recursive=True)  # -> Segments, Vertices
dispatch = Dispatch(List=explode.Segments, DispatchPattern=[True, False])  # -> ListA, ListB
explode_2 = Explode(Curve=[pline, move_3.Geometry], Recursive=True)  # -> Segments, Vertices
crv = Curve(dispatch.ListA)
crv_2 = Curve(dispatch.ListB)
crv_3 = Curve(explode_2.Segments)
digit_scroller = DigitScroller(Scroller_Digits=12, Scroller_Prefix="Material", Scroller_Radix=9, Scroller_Value=10)
digit_scroller_2 = DigitScroller(Scroller_Digits=12, Scroller_Prefix="Material", Scroller_Radix=9, Scroller_Value=10)
digit_scroller_3 = DigitScroller(Scroller_Digits=12, Scroller_Prefix="Material", Scroller_Radix=9, Scroller_Value=10)
# With this tag we can identify the compression
# members in Python.
panel = Panel("compression")
# The basic structure of the tensegrity is modeled with
# elastic members. During the simulation we change
# the length of the compression elements (blue) with Python.
# This way we simulate an extension of the members.
truss = EqTruss(Geometry=crv, Material=digit_scroller, Prestress=0, Tags=panel, Strategy=0)
truss_2 = EqTruss(Geometry=crv_2, Material=digit_scroller_2, Prestress=0, Strategy=0)
truss_3 = EqTruss(Geometry=crv_3, Material=digit_scroller_3, Prestress=0, Strategy=0)
# We apply vertical supports at the bottom.
# The structure is still kinematic. Therefore,
# we apply a Tikhonov regularization with
# the Newton component.
support = EqNodalSupport(Location=pt_2, FixX=False, FixY=False, FixZ=True)
model = EqModel(Elements=flatten([truss, truss_2, truss_3, support]), Tolerance=-1)
# Spin the wheel to change
# the length of the trusses (blue)
# during the solving process.
knob = ControlKnob(Decimals=2, Limit=True, Maximum=10, Minimum=1, Range=1, Value=1.1)
item = ListItem(List=crv, Index=0, Wrap=True)
len = Length(Curve=item)
multiplication_2 = Multiplication(A=len, B=knob)
# With this Python node we can
# update the analysis model.
python = GhPythonScript(model=model, length=multiplication_2)  # -> model
# ---------- python: Python ----------
__author__ = "Thomas Oberbichler"

from Rhino.Geometry import *

for element in model.DesignElements.All("compression"):
    element.RefLength = length
# ---------- end python ----------
# Thikonov regularization to prevent
# unpredictable behavior due to kinematics.
panel_2 = Panel("0.01")
# This node triggers further iteration steps periodically.
# The intermediate results are visualized.
trigger = Trigger(Interval=20, TimerInterval=20, Target=newtonsolver)
# We perform a single iteration
# with the Newton method and
# visualize the output.
newtonsolver = EqNewtonRaphsonSolver(Model=python, TikhonovRegularization=panel_2, MaximumIterations=1, ResidualTolerance=1e-05)  # -> Model, ResidualNorm
geometry = EqExtractGeometries(Model=newtonsolver.Model, Elements=truss)  # -> Geometry, Elements
geometry_2 = EqExtractGeometries(Model=newtonsolver.Model, Elements=[truss_2, truss_3])  # -> Geometry, Elements
# Visualization
pipe = Pipe(Curve=geometry.Geometry, Radius=0.1, Caps=1)
pipe_2 = Pipe(Curve=geometry_2.Geometry, Radius=0.01, Caps=0)
residuals = EqResiduals(Model=newtonsolver.Model, Tolerance=1e-05)  # -> Location, Residual
vdis = VectorDisplay(Anchor=residuals.Location, Vector=residuals.Residual)
preview = CustomPreview(Geometry=pipe, Material=ColourSwatch(SwatchColor=RGB(61, 139, 202)))
preview_2 = CustomPreview(Geometry=pipe_2, Material=ColourSwatch(SwatchColor=RGB(232, 60, 69)))
