# Grasshopper definition 002-EQlib-Force-Density-Method.gh (Grasshopper 1.0.7)
# plug-ins: EQlib

crv = Curve(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)
boundary = BoundarySurfaces(Edges=crv)
mesh = MeshBrep(
    Brep=boundary,
    Settings={GridMaxCount=0, GridMinCount=16, JaggedSeams=False, MaxEdgeLength=0, MinEdgeLength=0.0001, MinTolerance=0, Refine=True, RefineAngle=0, RelativeTolerance=0.65, SimplePlanes=True, Tolerance=0})
qrmesh = QuadRemesh(Mesh=mesh, Settings={aqc=True, as=50, dhe=True, gci=0, null=False, pme=0, sa=0, tqc=2000})
explode = Explode(Curve=crv, Recursive=True)  # -> Segments, Vertices
mesh_2 = Mesh(qrmesh)
end = EndPoints(Curve=explode.Segments)  # -> Start, End
medges = MeshEdges(Mesh=mesh_2)  # -> NakedEdges, InteriorEdges, NonManifoldEdges
demesh = DeconstructMesh(Mesh=mesh_2)  # -> Vertices, Faces, Colours, Normals
cp = ClosestPoint(Point=end.Start, Cloud=demesh.Vertices)  # -> ClosestPoint, CPIndex, Distance
# With this tags we can identify
# the members in Python.
panel = Panel("outer")
# Outer edges.
truss = EqTruss(Geometry=medges.NakedEdges, Prestress=0, Tags=panel, Strategy=0)
# Inner edges.
truss_2 = EqTruss(Geometry=medges.InteriorEdges, Prestress=0, Tags="inner", Strategy=0)
# Force density method is implemented with
# classical FEM. The elastic stiffness is neglected
# by selecting a Youngs modulus = 0 (= default).
# The force density will be applied as a prestress.
# Supports for the outer nodes.
support = EqNodalSupport(Location=cp.ClosestPoint, FixX=True, FixY=True, FixZ=True, Tags="support")
# We build the FEM model and modify
# the properties later in Python.
model = EqModel(Elements=flatten([truss_2, support, truss]), Tolerance=-1)
# Specify the force density
# for the outer edges.
knob = ControlKnob(Decimals=2, Limit=True, Maximum=10, Minimum=0, Range=1, Value=5)
len = Length(Curve=medges.NakedEdges)
multiplication = Multiplication(A=knob, B=len)
python = GhPythonScript(model=model, prestress=multiplication)  # -> model; inputs prestress: list
# ---------- python: Python ----------
__author__ = "Thomas Oberbichler"

from Rhino.Geometry import *

for element, p in zip(model.DesignElements.All("outer"), prestress):
    element.Prestress = p
# ---------- end python ----------
# Specify the force density
# for the inner edges.
knob_2 = ControlKnob(Decimals=2, Limit=True, Maximum=10, Minimum=0, Range=1, Value=0.5)
len_2 = Length(Curve=medges.InteriorEdges)
multiplication_2 = Multiplication(A=knob_2, B=len_2)
python_2 = GhPythonScript(model=python, prestress=multiplication_2)  # -> model; inputs prestress: list
# ---------- python_2: Python ----------
__author__ = "Thomas Oberbichler"

from Rhino.Geometry import *

for element, p in zip(model.DesignElements.All("inner"), prestress):
    element.Prestress = p
# ---------- end python_2 ----------
# Select and use the Rhino-gumballs
# to move the supports.
pt = Point([Point(17, 33, 0), Point(37, 45, 15.74273052), Point(32, 62, 0), Point(51.10424042, 67.9546814, 15.54504012), Point(74, 58, 0), Point(73, 42, 19.37329316), Point(90, 28, 0), Point(67, 14, 0), Point(57, 32, 11.72255279), Point(44, 10, 0), Point(15, 6, 17.63672386)])
python_3 = GhPythonScript(model=python_2, location=pt)  # -> model; inputs location: list of Point3d
# ---------- python_3: Python ----------
__author__ = "Thomas Oberbichler"

from Rhino.Geometry import *

for element, pt in zip(model.DesignElements.All("support"), location):
    element.Location = pt
# ---------- end python_3 ----------
# Newton method solves the force-density
# problem with a single iteration.
newtonsolver = EqNewtonRaphsonSolver(Model=python_3, TikhonovRegularization=0, MaximumIterations=1, ResidualTolerance=1e-05)  # -> Model, ResidualNorm
