# Grasshopper definition 003-EQlib-Updated-Reference-Strategy.gh (Grasshopper 1.0.7)
# plug-ins: EQlib

geo = Geometry(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)
geo_2 = Geometry(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)
# With the tags we can identify
# the members in Python.
panel = Panel("outer")
# Springs at the edges
# to support the structure.
outer = EqOuterEdge(Geometry=geo)
# Edge cables.
outer_2 = EqOuterEdge(Geometry=geo_2)
spring = EqSpring(Geometry=outer, Stiffness=Vector(10000, 10000, 10000), Orientation=PlaneXY(0, 0, 0))
# Activate updated reference strategy (URS)
# in context menu.
membrane = EqMembrane(Geometry=geo, Thickness=1, Prestress=Slider(5, range=0..10), ReferenceArea=-1, Strategy=1)
# Activate updated reference strategy (URS)
# in context menu.
membrane_2 = EqMembrane(Geometry=geo_2, Thickness=1, Prestress=Slider(1, range=0..10), ReferenceArea=-1, Strategy=1)
truss = EqTruss(Geometry=outer_2, Prestress=0, Tags=panel, Strategy=1)
support = EqNodalSupport(
    Location=[Point(26.90983006, 9.122147477, 0), Point(26.90983006, 20.87785252, 0), Point(38.09016994, 24.51056516, 0), Point(45, 15, 0), Point(38.09016994, 5.489434837, 0)],
    FixX=True,
    FixY=True,
    FixZ=True,
    Tags="support")
# Add coupling elements at the edges.
coupling = EqCoupling(Geometry=geo_2, Weight=10000)
model = EqModel(Elements=flatten([membrane, spring]), Tolerance=-1)
model_2 = EqModel(Elements=flatten([coupling, membrane_2, truss, support]), Tolerance=-1)
trigger = Trigger(Interval=20, TimerInterval=20, Target=newtonsolver)
# Specify the prestress in
# the edge cables.
knob = ControlKnob(Decimals=0, Limit=False, Maximum=100, Minimum=0, Range=50, Value=10)
newtonsolver = EqNewtonRaphsonSolver(Model=model, TikhonovRegularization=0, MaximumIterations=1, ResidualTolerance=1e-05)  # -> Model, ResidualNorm
python = GhPythonScript(model=model_2, prestress=knob)  # -> model
# ---------- python: Python ----------
__author__ = "Thomas Oberbichler"

from Rhino.Geometry import *

for element in model.DesignElements.All("outer"):
    element.Prestress = prestress
# ---------- end python ----------
geometry = EqExtractGeometries(Model=newtonsolver.Model, Elements=membrane)  # -> Geometry, Elements
# Select and use the Rhino-gumballs
# to move the supports.
P = Location([Point(26.90983006, 9.122147477, 0), Point(26.90983006, 20.87785252, 7.245519553), Point(38.09016994, 24.51056516, 0), Point(45, 15, 7.619824909), Point(38.09016994, 5.489434837, 0)])
python_2 = GhPythonScript(model=python, location=P)  # -> model; inputs location: list of Point3d
# ---------- python_2: Python ----------
__author__ = "Thomas Oberbichler"

from Rhino.Geometry import *

for element, pt in zip(model.DesignElements.All("support"), location):
    element.Location = pt
# ---------- end python_2 ----------
trigger_2 = Trigger(Interval=100, TimerInterval=100, Target=newtonsolver_2)
newtonsolver_2 = EqNewtonRaphsonSolver(Model=python_2, TikhonovRegularization=0, MaximumIterations=1, ResidualTolerance=1e-05)  # -> Model, ResidualNorm
geometry_2 = EqExtractGeometries(Model=newtonsolver_2.Model, Elements=truss)  # -> Geometry, Elements
