# Grasshopper definition 004-EQlib-Hybrid-Structure.gh (Grasshopper 1.0.7)
# plug-ins: EQlib

# Parametric geometry
width = Slider(10, range=0..10)
mesh_m = Slider(20, range=1..20)
mesh_n = Slider(40, range=1..40)
number_slider = Slider(10, range=0..10)
vec = VectorXYZ(XComponent=expr("-x", number_slider), YComponent=width, ZComponent=0)  # -> Vector, Length
vec_2 = VectorXYZ(XComponent=number_slider, YComponent=width, ZComponent=0)  # -> Vector, Length
arc = Arc(Plane=PlaneXZ(0, 0, 0), Radius=number_slider, Angle=Domain(0, 3.141592654))  # -> Arc, Length
ln = Line(StartPoint=vec_2.Vector, EndPoint=vec.Vector)
crv = Curve(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)
crv_2 = Curve(ln)
crv_3 = Curve(arc.Arc)
python = GhPythonScript(curve=crv_3, n=mesh_n)  # -> frames, xforms; inputs curve: Curve, n: Int32
# ---------- python: Python ----------
__author__ = "Thomas Oberbichler"

from Rhino.Geometry import *

ts = curve.DivideByCount(n, True)
frames = curve.GetPerpendicularFrames(ts)

xforms = [Transform.PlaneToPlane(frames[0], frame) for frame in frames]
# ---------- end python ----------
scale_nu = ScaleNU(Geometry=crv, Plane=PlaneXY(0, 0, 0), ScaleX=Slider(1, range=0..10), ScaleY=Slider(2, range=0..10), ScaleZ=1)  # -> Geometry, Transform
item = ListItem(List=python.frames, Index=0, Wrap=True)
orient = Orient(Geometry=scale_nu.Geometry, Source=item, Target=PlaneXY(0, 0, 0))  # -> Geometry, Transform
python_2 = GhPythonScript(a=crv_2, b=crv_3, n=mesh_n, m=mesh_m)  # -> faces; inputs a: Curve, b: Curve, n: Int32, m: Int32
# ---------- python_2: Python ----------
__author__ = "Thomas Oberbichler"

from Rhino.Geometry import *

faces = []

def idx(i, j):
    return i * (m + 1) + j

for i in range(n):
    for j in range(m):
        face = MeshFace(idx(i, j), idx(i, j + 1), idx(i + 1, j + 1), idx(i + 1, j))
        faces.append(face)
# ---------- end python_2 ----------
divide = DivideCurve(Curve=crv_2, Count=mesh_n, Kinks=False)  # -> Points, Tangents, Parameters
divide_2 = DivideCurve(Curve=crv_3, Count=mesh_n, Kinks=False)  # -> Points, Tangents, Parameters
crv_4 = Curve(orient.Geometry)
ln_2 = Line(StartPoint=divide.Points, EndPoint=divide_2.Points)
transform = Transform(Geometry=crv_4, Transform=python.xforms)
divide_3 = DivideCurve(Curve=ln_2, Count=mesh_m, Kinks=False)  # -> Points, Tangents, Parameters
conmesh = ConstructMesh(Vertices=flatten(divide_3.Points), Faces=python_2)
cp = ControlPoints(Curve=transform)  # -> Points, Weights, Knots
flip = FlipMatrix(Data=divide_3.Points)
item_2 = ListItem(List=divide_3.Points, Index=0, Wrap=True)
item_3 = ListItem(List=transform, Index=0, Wrap=True)  # -> Item1, Item
shift = ShiftList(List=cp.Points, Shift=1, Wrap=False)
shift_2 = ShiftList(List=shift, Shift=1, Wrap=True)
shift_3 = ShiftList(List=shift_2, Shift=1, Wrap=True)
pline = PolyLine(Vertices=flatten(item_2), Closed=False)
item_4 = ListItem(List=flip, Index=[0, -1], Wrap=True)
mirror = Mirror(Geometry=conmesh, Plane=Plane(origin=(0, 0, 0), x=(0, 0, 1), y=(1, 0, 0)))  # -> Geometry, Transform
cp_2 = ControlPoints(Curve=item_3.Item1)  # -> Points, Weights, Knots
cp_3 = ControlPoints(Curve=item_3.Item)  # -> Points, Weights, Knots
mirror_2 = Mirror(Geometry=item_4, Plane=Plane(origin=(0, 0, 0), x=(0, 0, 1), y=(1, 0, 0)))  # -> Geometry, Transform
mirror_3 = Mirror(Geometry=pline, Plane=Plane(origin=(0, 0, 0), x=(0, 0, 1), y=(1, 0, 0)))  # -> Geometry, Transform
flip_2 = FlipMatrix(Data=shift)
flip_3 = FlipMatrix(Data=shift_2)
flip_4 = FlipMatrix(Data=shift_3)
item_5 = ListItem(List=cp_3.Points, Index=[0, 2], Wrap=True)
item_6 = ListItem(List=cp_2.Points, Index=[0, 2], Wrap=True)
P = Pattern([0, 1, 2])
long = LongestList(ListA=flip_2, ListB=P, PaddingMode=4)  # -> ListA, ListB

# ---- group: Mesh for membrane
mjoin = MeshJoin(Meshes=[conmesh, mirror.Geometry])

# ---- group: Points for supports
pt = Point([item_4, mirror_2.Geometry])

# ---- group: Curves for edge cables
crv_5 = Curve([pline, mirror_3.Geometry])

# ---- group: Points for supports
pt_2 = Point([item_5, item_6])

# ----
p_n_c = PickNChoose(Pattern=long.ListB, Stream0=flip_2, Stream1=flip_3, Stream2=flip_4)
p_n_c_2 = PickNChoose(Pattern=long.ListB, Stream0=flip_3, Stream1=flip_2, Stream2=flip_4)
pline_2 = PolyLine(Vertices=flip_2, Closed=False)
pline_3 = PolyLine(Vertices=p_n_c, Closed=False)
pline_4 = PolyLine(Vertices=p_n_c_2, Closed=False)
crv_6 = Curve([pline_2, pline_3, pline_4, transform])
explode = Explode(Curve=crv_6, Recursive=True)  # -> Segments, Vertices

# ---- group: Lines for trusses
crv_7 = Curve(explode.Segments)

# ----
# An elastic strut-and-tie construction.
# Here we specify an elastic stiffness.
digit_scroller = DigitScroller(Scroller_Digits=12, Scroller_Prefix="Material", Scroller_Radix=9, Scroller_Value=200)
# For the membranes we
# prescribe the prestress.
# 
# The elastic stiffness is
# neglacted by using a Youngs
# modulus = 0 (default).
# 
# From the context menu we
# select the updated reference
# strategy (URS). This is to
# achieve the desired prestress
# in the final solution.
# Supports are fixing the
# location of the outer nodes.
number_slider_2 = Slider(1, range=0..1)
# We put edge cable on both sides.
# They are also part of the form finding.
# We prescribe the prestress, neglect
# the elastic stiffness and activate URS.
number_slider_3 = Slider(100, range=0..100)
# EQlib - Form finding
membrane = EqMembrane(Geometry=mjoin, Thickness=1, Prestress=number_slider_2, ReferenceArea=-1, Strategy=1)
truss = EqTruss(Geometry=crv_5, Prestress=number_slider_3, Strategy=0)
truss_2 = EqTruss(Geometry=crv_7, Material=digit_scroller, Prestress=0, Strategy=0)
support = EqNodalSupport(Location=pt, FixX=True, FixY=True, FixZ=True)
# Additional supports for the
# strut-and-tie construction.
support_2 = EqNodalSupport(Location=pt_2, FixX=True, FixY=True, FixZ=True)
# We create a
# FEM model...
model = EqModel(Elements=flatten([support, truss_2, support_2, truss, membrane]), Tolerance=-1)
# We compute max.
# 30 iterations in each
# solving step.
panel = Panel("30")
# For this model we
# use a higher tolerance.
panel_2 = Panel("0.002")
# ...and solve it using
# Newtons method.
newtonsolver = EqNewtonRaphsonSolver(Model=model, TikhonovRegularization=0, MaximumIterations=panel, ResidualTolerance=panel_2)  # -> Model, ResidualNorm
# The residual norm
# indicates the quality
# of the solution.
panel_3 = Panel(newtonsolver.ResidualNorm)
digit_scroller_2 = DigitScroller(Scroller_Digits=12, Scroller_Prefix="Factor", Scroller_Radix=9, Scroller_Value=-0.05)
geometry = EqExtractGeometries(Model=newtonsolver.Model, Elements=membrane)  # -> Geometry, Elements
Z = UnitZ(Factor=digit_scroller_2)
membrane_2 = EqMembrane(
    Geometry=geometry.Geometry,
    Thickness=1,
    Material=Slider(100, range=0..100),
    Prestress=number_slider_2,
    ReferenceArea=-1,
    Strategy=0)
load = EqSurfaceLoad(Geometry=geometry.Geometry, Load=Z, IsLocalLoad=False, Strategy=0)
# In this model we replace
# the URS membranes
# with elastic membranes
# and add a vertical load.
dupmodel = EqDuplicateModel(Model=newtonsolver.Model, NewElements=flatten([load, membrane_2]), SkipElements=flatten(membrane))
# EQlib - Structural analysis
# In this model we remove
# the membranes.
# The strut-and-tie model
# returns to its initial position.
dupmodel_2 = EqDuplicateModel(Model=newtonsolver.Model, SkipElements=flatten(membrane))
# Again we use the
# Newton solver to
# find equilibrium.
newtonsolver_2 = EqNewtonRaphsonSolver(Model=dupmodel, TikhonovRegularization=0, MaximumIterations=100, ResidualTolerance=1e-05)  # -> Model, ResidualNorm
newtonsolver_3 = EqNewtonRaphsonSolver(Model=dupmodel_2, TikhonovRegularization=0, MaximumIterations=100, ResidualTolerance=1e-05)  # -> Model, ResidualNorm
data = Data(newtonsolver_2.Model)
# The residual forces are
# representing the support
# forces.
residuals = EqResiduals(Model=newtonsolver_2.Model, Tolerance=0.0001)  # -> Location, Residual
geometry_2 = EqExtractGeometries(Model=data, Elements=membrane_2)  # -> Geometry, Elements
geometry_3 = EqExtractGeometries(Model=data, Elements=truss_2)  # -> Geometry, Elements
geometry_4 = EqExtractGeometries(Model=data, Elements=truss)  # -> Geometry, Elements
vdis = VectorDisplay(Anchor=residuals.Location, Vector=residuals.Residual)
pipe = Pipe(Curve=geometry_3.Geometry, Radius=0.03, Caps=0)
pipe_2 = Pipe(Curve=geometry_4.Geometry, Radius=0.08, Caps=0)
preview = CustomPreview(Geometry=geometry_2.Geometry, Material=ColourSwatch(SwatchColor=RGB(181, 169, 139)))
preview_2 = CustomPreview(Geometry=pipe, Material=ColourSwatch(SwatchColor=RGB(214, 214, 214)))
preview_3 = CustomPreview(Geometry=pipe_2, Material=ColourSwatch(SwatchColor=RGB(139, 148, 181)))
