# Grasshopper definition 005-EQlib-Balloon.gh (Grasshopper 1.0.7)
# plug-ins: EQlib

brep = Brep(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)
# The tag allows us to
# identify the load element
# later in Python.
panel = Panel("Pressure")
outer = EqOuterEdge(Geometry=brep)
# The membrane of
# the "balloon".
membrane = EqMembrane(
    Geometry=brep,
    Thickness=1,
    Material=Slider(1, range=0..100),
    Prestress=Slider(1, range=0..100),
    ReferenceArea=-1,
    Strategy=0)
# Springs at the edges
# to support the structure.
spring = EqSpring(Geometry=outer, Stiffness=Vector(10000, 10000, 10000), Orientation=PlaneXY(0, 0, 0))
# A local load acting on
# the updated surface.
load = EqSurfaceLoad(Geometry=brep, Load=Vector(0, 0, 0), Tags=panel, IsLocalLoad=True, Strategy=1)
model = EqModel(Elements=flatten([membrane, spring, load]), Tolerance=-1)
# Spin the wheel to
# blow-up the balloon.
knob = ControlKnob(Decimals=2, Limit=False, Maximum=10, Minimum=0, Range=1, Value=0.7)
# With this Python node we can
# update the analysis model.
python = GhPythonScript(model=model, p=knob)  # -> model
# ---------- python: Python ----------
__author__ = "Thomas Oberbichler"

from Rhino.Geometry import *

model.DesignElements["Pressure"].Load = p * Vector3d.ZAxis
# ---------- end python ----------
# This node triggers further iteration steps periodically.
# The intermediate results are visualized.
trigger = Trigger(Interval=20, TimerInterval=20, Target=newtonsolver)
newtonsolver = EqNewtonRaphsonSolver(Model=python, TikhonovRegularization=0.01, MaximumIterations=1, ResidualTolerance=1e-05)  # -> Model, ResidualNorm
geometry = EqExtractGeometries(Model=newtonsolver.Model)  # -> Geometry, Elements
residuals = EqResiduals(Model=newtonsolver.Model, Tolerance=1e-05)  # -> Location, Residual
vdis = VectorDisplay(Anchor=residuals.Location, Vector=residuals.Residual)
preview = CustomPreview(Geometry=geometry.Geometry, Material=ColourSwatch(SwatchColor=RGB(255, 224, 153)))
