# Grasshopper definition 006-EQlib-Grid-Shell.gh (Grasshopper 1.0.7)
# plug-ins: EQlib

crv = Curve(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)
crv_2 = Curve(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)
crv_3 = Curve(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)
divide = DivideCurve(Curve=[crv, crv_2, crv_3], Count=Slider(10, range=0..20), Kinks=False)  # -> Points, Tangents, Parameters
flip = FlipMatrix(Data=divide.Points)
intcrv = Interpolate(Vertices=flip, Degree=3, Periodic=False, KnotStyle=1)  # -> Curve, Length, Domain
item = ListItem(List=flatten(intcrv.Curve), Index=0, Wrap=True)  # -> Item1, Item
rotate = Rotate(Geometry=[item.Item1, item.Item], Angle=1.570796327, Plane=PlaneXY(0, 0, 0))  # -> Geometry, Transform
loft = Loft(Curves=rotate.Geometry, Options={Adjust=False, Closed=False, LoftEnds=0, LoftSimp=0, LoftType=0, Rebuild=10, Refit=0.01})
Z = UnitZ(Factor=1)
extr = Extrude(Base=loft, Direction=Z)
move = Move(Geometry=extr, Motion=Vector(0, 0, -0.5))  # -> Geometry, Transform
number_slider = Slider(0.5, range=0..1)
trim = TrimWithBreps(Curve=intcrv.Curve, Brep=move.Geometry)  # -> Inside, Outside
crv_4 = Curve(trim.Inside)
ext = ExtendCurve(Curve=crv_4, Type=2, Start=number_slider, End=number_slider)
crv_5 = Curve(ext)
reb = RebuildCurve(Curve=crv_5, Count=6, Tangents=False)
rotate_2 = Rotate(Geometry=reb, Angle=1.570796327, Plane=PlaneXY(0, 0, 0))  # -> Geometry, Transform
crv_6 = Curve(reparameterize(flatten([reb, rotate_2.Geometry])))
item_2 = ListItem(List=flatten(crv_5), Index=0, Wrap=True)  # -> Item1, Item
Z_2 = UnitZ(Factor=1)
end = EndPoints(Curve=item_2.Item1)  # -> Start, End
end_2 = EndPoints(Curve=item_2.Item)  # -> Start, End

# ---- group: Geometry of deformed lamellas
extr_2 = Extrude(Base=crv_6, Direction=Z_2)

# ---- group: Geometry of undeformed lamellas
len = Length(Curve=crv_6)
vec = VectorXYZ(XComponent=len, YComponent=0, ZComponent=0)  # -> Vector, Length
ln = Line(StartPoint=Point(0, 0, 0), EndPoint=vec.Vector)
extr_3 = Extrude(Base=ln, Direction=Z_2)

# ----
pt = Point([end.Start, end_2.End])
pt_2 = Point([end.End, end_2.Start])
rotate_3 = Rotate(Geometry=pt, Angle=1.570796327, Plane=PlaneXY(0, 0, 0))  # -> Geometry, Transform
rotate_4 = Rotate(Geometry=pt_2, Angle=1.570796327, Plane=PlaneXY(0, 0, 0))  # -> Geometry, Transform
srf = Surface(reparameterize(extr_2))
pt_3 = Point([pt_2, rotate_3.Geometry])
pt_4 = Point([pt, rotate_4.Geometry])
shell = EqShell(Geometry=srf, Thickness=1, Material=Slider(10, range=0..10), ReferenceGeometry=extr_3, Strategy=0)
coupling = EqCouplingByIntersection(Geometries=extr_2, Weight=10000)
spring = EqSpring(Geometry=pt_4, Stiffness=Vector(0, 0, 10000), Orientation=PlaneXY(0, 0, 0), Tags="supports")
support = EqNodalSupport(Location=pt_3, FixX=False, FixY=False, FixZ=True)

# ---- group: Select and use gumball
pt_5 = Point(Point(0, 0, 11.94986315))

# ----
model = EqModel(Elements=flatten([shell, coupling, support, spring]), Tolerance=-1)
python = GhPythonScript(model=model, point=pt_5)  # -> model; inputs point: Point3d
# ---------- python: Python ----------
__author__ = "Thomas Oberbichler"

from Rhino.Geometry import *

for element in model.DesignElements.All('supports'):
    element.SetLocationZ(point.Z)
# ---------- end python ----------
trigger = Trigger(Interval=20, TimerInterval=20, Target=newtonsolver)
newtonsolver = EqNewtonRaphsonSolver(Model=python, TikhonovRegularization=Slider(0.0001, range=0..0.0001), MaximumIterations=1, ResidualTolerance=1e-05)  # -> Model, ResidualNorm
