# Grasshopper definition 008-EQlib-Kite.gh (Grasshopper 1.0.7)
# plug-ins: EQlib

geo = Geometry([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])
geo_2 = Geometry([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])
geo_3 = Geometry([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])
P = Location(Point(20, -26, 0))
number_slider = Slider(10000, range=0..10000)
pt = Point([Point(-9, 20, 0), Point(3, 17, 0), Point(13, 10, 0), Point(18, -2, 0), Point(20, -14, 0)])
vec = Vector(Vector(50, 0, 0))
move = Move(Geometry=geo_3, Motion=vec)  # -> Geometry, Transform
move_2 = Move(Geometry=geo_2, Motion=vec)  # -> Geometry, Transform
move_3 = Move(Geometry=geo, Motion=vec)  # -> Geometry, Transform
move_4 = Move(Geometry=P, Motion=vec)  # -> Geometry, Transform
move_5 = Move(Geometry=pt, Motion=vec)  # -> Geometry, Transform
truss = EqTruss(Geometry=move_3.Geometry, Prestress=0, ReferenceLength=-1, Tags="prestressed-cables", Strategy=1)
truss_2 = EqTruss(Geometry=move_2.Geometry, Material=number_slider, Prestress=0, Tags="lower-cables", Strategy=0)
truss_3 = EqTruss(Geometry=move.Geometry, Material=number_slider, Prestress=0, Tags="upper-cables", Strategy=0)
support = EqNodalSupport(Location=move_4.Geometry, FixX=True, FixY=True, FixZ=True)
load = EqNodalLoad(Location=move_5.Geometry, Load=Vector(0, 0, 0), Tags="loads")
model = EqModel(Elements=flatten([load, truss, support, truss_2, truss_3]), Tolerance=-1)

# ---- group: Select and use gumball to change external force
pt_2 = Point([Point(-12.69619415, 20.1553235, 0), Point(1.711825923, 20.22578449, 0), Point(12.0764573, 14.55414412, 0), Point(21.0361542, 0.8455720842, 0), Point(24.68927468, -12.68442231, 0)])

# ---- group: Prestress in green elements
knob = ControlKnob(Decimals=2, Limit=True, Maximum=20, Minimum=0, Range=10, Value=3)

# ---- group: Switch results
list = ValueList({"Force": 0, "Length": 1}, selected="Force")

# ----
vec2pt = Vector2Pt(PointA=pt, PointB=pt_2, Unitize=False)  # -> Vector, Length
python = GhPythonScript(model=model, f=vec2pt.Vector)  # -> out, model; inputs f: list of Vector3d
# ---------- python: Python ----------
__author__ = "Thomas Oberbichler"

from Rhino.Geometry import *

for element, load in zip(model.DesignElements.All("loads"), f):
    element.Load = load
# ---------- end python ----------

# ---- group: Length of blue elements
knob_2 = ControlKnob(Decimals=2, Limit=True, Maximum=20, Minimum=0, Range=10, Value=9.45)

# ----
python_2 = GhPythonScript(model=python.model, prestress=knob)  # -> out, model
# ---------- python_2: Python ----------
__author__ = "Thomas Oberbichler"

from Rhino.Geometry import *

for element in model.DesignElements.All("prestressed-cables"):
    element.Prestress = prestress
# ---------- end python_2 ----------
vdis = VectorDisplay(Anchor=pt, Vector=vec2pt.Vector)

# ---- group: Length of purple elements
knob_3 = ControlKnob(Decimals=2, Limit=True, Maximum=20, Minimum=0, Range=10, Value=14.41)

# ----
python_3 = GhPythonScript(model=python_2.model, lower=knob_2, upper=knob_3)  # -> out, model
# ---------- python_3: Python ----------
__author__ = "Thomas Oberbichler"

from Rhino.Geometry import *

for element in model.DesignElements.All("lower-cables"):
    element.RefLength = lower

for element in model.DesignElements.All("upper-cables"):
    element.RefLength = upper
# ---------- end python_3 ----------
trigger = Trigger(Interval=20, TimerInterval=20, Target=newtonsolver)
newtonsolver = EqNewtonRaphsonSolver(Model=python_3.model, TikhonovRegularization=0.001, MaximumIterations=1, ResidualTolerance=1e-05)  # -> Model, ResidualNorm
geometry = EqExtractGeometries(Model=newtonsolver.Model, Elements=flatten([truss_2, truss, truss_3]))  # -> Geometry, Elements
geometry_2 = EqExtractGeometries(Model=newtonsolver.Model, Elements=truss)  # -> Geometry, Elements
geometry_3 = EqExtractGeometries(Model=newtonsolver.Model, Elements=truss_2)  # -> Geometry, Elements
geometry_4 = EqExtractGeometries(Model=newtonsolver.Model, Elements=truss_3)  # -> Geometry, Elements
preview = CustomPreview(
    Geometry=geometry_2.Geometry,
    Material={diffuse=RGB(80, 176, 104), emission=RGB(24, 53, 31), shine=0.5, specular=RGB(255, 255, 255), transparency=0})
preview_2 = CustomPreview(
    Geometry=geometry_3.Geometry,
    Material={diffuse=RGB(61, 139, 202), emission=RGB(18, 42, 61), shine=0.5, specular=RGB(255, 255, 255), transparency=0})
preview_3 = CustomPreview(
    Geometry=geometry_4.Geometry,
    Material={diffuse=RGB(109, 79, 149), emission=RGB(33, 24, 45), shine=0.5, specular=RGB(255, 255, 255), transparency=0})
python_4 = GhPythonScript(element=geometry.Elements)  # -> out, model, a, b, n, l
# ---------- python_4: Python ----------
__author__ = "Thomas Oberbichler"

from Rhino.Geometry import *

a = element.LineCurve.PointAtStart
b = element.LineCurve.PointAtEnd

L = element.RefLength if element.RefLength > 0 else element.RefLineCurve.GetLength()
l = element.LineCurve.GetLength()

eps_gl = (l**2 - L**2) / (2 * L**2)

sig_pk2 = eps_gl * element.Material.YoungsModulus + element.Prestress

n = sig_pk2 * element.CrossSection.Area * l / L
# ---------- end python_4 ----------
ln = Line(StartPoint=python_4.a, EndPoint=python_4.b)
p_n_c = PickNChoose(Pattern=list, Stream0=graft(python_4.n), Stream1=graft(python_4.l))
midpt = CurveMiddle(Curve=ln)
format = Format(Format="{0:0.###}", Culture=127, Data0=p_n_c)
tag = TextTag(Location=graft(midpt), Text=format)
