# Grasshopper definition 009-EQlib-Strips.gh (Grasshopper 1.0.7)
# plug-ins: EQlib

pt = Point(Point(0, 0, 0))
pt_2 = Point(Point(0, 5, 0))
pt_3 = Point(Point(35, 0, 0))
pt_4 = Point(Point(35, 5, 0))
ln = Line(StartPoint=pt, EndPoint=pt_2)
ln_2 = Line(StartPoint=pt_3, EndPoint=pt_4)
loft = Loft(Curves=[ln, ln_2], Options={Adjust=False, Closed=False, LoftEnds=0, LoftSimp=0, LoftType=0, Rebuild=10, Refit=0.01})
python = GhPythonScript(srf=loft)  # -> srf; inputs srf: Surface
# ---------- python: Python ----------
__author__ = "Thomas Oberbichler"

from Rhino.Geometry import *

srf = srf.Rebuild(3, 1, 20, 2)
# ---------- end python ----------
knob = ControlKnob(Decimals=2, Limit=True, Maximum=90, Minimum=0, Range=90, Value=0)
len = Length(Curve=ln)
a0 = Point(Point(0, 0, 0))
b0 = Point(Point(0, 10, 0))
python_2 = GhPythonScript(a=a0, b=b0, length=len, angle=knob)  # -> a, b, n; inputs a: Point3d, b: Point3d
# ---------- python_2: Python ----------
__author__ = "Thomas Oberbichler"

from Rhino.Geometry import *
from math import radians

direction = b - a
direction /= direction.Length

b = a + length * direction

frame = Plane(a, direction, Vector3d.ZAxis)
frame.Rotate(-radians(angle), direction)

n = frame.YAxis
# ---------- end python_2 ----------
digit_scroller = DigitScroller(Scroller_Digits=12, Scroller_Prefix="Material", Scroller_Radix=9, Scroller_Value=10)
knob_2 = ControlKnob(Decimals=2, Limit=True, Maximum=90, Minimum=0, Range=90, Value=0)
len_2 = Length(Curve=ln_2)
a1 = Point(Point(35, 0, 0))
b1 = Point(Point(35, 10, 0))
merge = Merge(Data1=pt, Data2=pt_2, Data3=pt_3, Data4=pt_4)
edge = EqSelectEdge(Geometry=python, EdgeIndex=[3, 1])
python_3 = GhPythonScript(a=a1, b=b1, length=len_2, angle=knob_2)  # -> a, b, n; inputs a: Point3d, b: Point3d
# ---------- python_3: Python ----------
__author__ = "Thomas Oberbichler"

from Rhino.Geometry import *
from math import radians

direction = b - a
direction /= direction.Length

b = a + length * direction

frame = Plane(a, direction, Vector3d.ZAxis)
frame.Rotate(radians(angle), direction)

n = frame.YAxis
# ---------- end python_3 ----------
shell = EqShell(Geometry=python, Thickness=1, Material=digit_scroller, Strategy=0)
nspring = EqTangentSpring(Geometry=edge, Stiffness=10000, Tags="tangential-springs")
spring = EqSpring(Geometry=merge, Stiffness=Vector(10000, 10000, 10000), Orientation=PlaneXY(0, 0, 0), Tags="supports")
model = EqModel(Elements=flatten([shell, nspring, spring]), Tolerance=-1)
merge_2 = Merge(Data1=python_2.a, Data2=python_2.b, Data3=python_3.a, Data4=python_3.b)
merge_3 = Merge(Data1=python_2.n, Data2=python_3.n)
python_4 = GhPythonScript(model=model, supports=merge_2, normals=merge_3)  # -> model; inputs supports: list of Point3d, normals: list of Vector3d
# ---------- python_4: Python ----------
__author__ = "Thomas Oberbichler"

from Rhino.Geometry import *

for element, support in zip(model.DesignElements.All("supports"), supports):
    element.SetLocation(support)


for element, normal in zip(model.DesignElements.All("tangential-springs"), normals):
    element.SetNormal(normal)
# ---------- end python_4 ----------
trigger = Trigger(Interval=20, TimerInterval=20, Target=newtonsolver)
newtonsolver = EqNewtonRaphsonSolver(Model=python_4, TikhonovRegularization=0.01, MaximumIterations=1, ResidualTolerance=1e-05)  # -> Model, ResidualNorm
panel = Panel(newtonsolver.ResidualNorm)
